# Grasshopper definition 260511_回归预测模型.gh (Grasshopper 1.0.8)
# plug-ins: SimpleML

# ----
# 引入scikit-learn数据库
panel = Panel("diabetes")
# 分类算法演示
load_dataset = LoadDataset(DatasetName=panel)  # -> Data, Labels, Info, Readme
panel_2 = Panel(load_dataset.Readme)
panel_3 = Panel(load_dataset.Info)
panel_4 = Panel(load_dataset.Labels)
panel_5 = Panel(load_dataset.Data)

describe_features = DescribeFeatures(Data=load_dataset.Data, FeatureIndex=0)  # -> Description, Readme
# 数据分析工具
calculate_correlation = CalculateCorrelation(Data=load_dataset.Data, Method="pearson")  # -> CorrelationMatrix, Analysis, Readme
calculate_statistics = CalculateStatistics(Data=load_dataset.Data)  # -> Statistics, Readme
panel_6 = Panel(calculate_statistics.Statistics)

# ----
# 可选择的算法
knn_regressor = KNNRegressor(NNeighbors=5, Weights="uniform", Algorithm="auto", LeafSize=30, P=2, Metric="minkowski", NJobs=0)  # -> AlgorithmParams, Readme
lasso_regression = LassoRegression(Alpha=1, FitIntercept=True, MaxIter=1000, Tol=0.0001, Selection="cyclic", RandomState=0, WarmStart=False)  # -> AlgorithmParams, Readme
linear_regression = LinearRegression(FitIntercept=True, Normalize=False, CopyX=True, NJobs=0)  # -> AlgorithmParams, Readme
random_forest_regressor = RandomForestRegressor(
    NEstimators=100,
    MaxDepth=0,
    MinSamplesSplit=2,
    MinSamplesLeaf=1,
    MaxFeatures="sqrt",
    Bootstrap=True,
    RandomState=0,
    Criterion="squared_error")  # -> AlgorithmParams, Readme
ridge_regression = RidgeRegression(Alpha=1, FitIntercept=True, Solver="auto", MaxIter=0, Tol=0.0001, RandomState=0)  # -> AlgorithmParams, Readme
svr = SVR(Kernel="rbf", C=1, Gamma="scale", Degree=3, Coef0=0, Epsilon=0.1, Tol=0.001)  # -> AlgorithmParams, Readme

# ----
# 创建数据集
number_slider = Slider(10, range=0..10)
number_slider_2 = Slider(10, range=0..10)
list_item = ListItem(List=load_dataset.Data, Index=number_slider, Wrap=True)
cull_index = CullIndex(List=load_dataset.Labels, Indices=number_slider_2, Wrap=True)
list_item_2 = ListItem(List=load_dataset.Labels, Index=number_slider_2, Wrap=True)
cull_index_2 = CullIndex(List=load_dataset.Data, Indices=number_slider, Wrap=True)

number = Number(list_item)

create_dataset = CreateDataset(
    X=cull_index_2,
    Y=number,
    XNames=cull_index,
    YNames=list_item_2,
    Normalize=False,
    NormalizeMethod="standard",
    RemoveOutliers=False,
    HandleMissing=False,
    MissingStrategy="mean")  # -> Dataset, Info, Readme
split_dataset = SplitDataset(Dataset=create_dataset.Dataset, TestSize=0.2, RandomState=42)  # -> TrainDataset, TestDataset, Readme

# ----
# 训练模型
train_regressor = TrainRegressor(Dataset=split_dataset.TrainDataset, Algorithm=knn_regressor.AlgorithmParams)  # -> Model, ModelInfo, Readme

# ----
# 保存和的读取模型
panel_7 = Panel("C:\Users\Administrator\OneDrive\Desktop\simpleML examples\260128_test_regressor")
save_model = SaveModel(Model=train_regressor.Model, Filepath=panel_7, Save=Toggle(True))  # -> SavedPath, Readme
load_model = LoadModel(Filepath=save_model.SavedPath)  # -> Model, ModelInfo, Readme
panel_8 = Panel(save_model.SavedPath)

# ----
# 用模型进行预测
deconstruct_dataset = DeconstructDataset(Dataset=split_dataset.TestDataset)  # -> X, Y, XNames, YNames, Readme
predict_regressor = PredictRegressor(Model=train_regressor.Model, X=deconstruct_dataset.X)  # -> Predictions, Readme
panel_9 = Panel(predict_regressor.Predictions)

# ----
# 模型评估
evaluate_regression = EvaluateRegression(Model=train_regressor.Model, TestDataset=split_dataset.TestDataset)  # -> Metrics, Report, Predictions, Readme
panel_10 = Panel(evaluate_regression.Report)
